# Grasshopper definition 5 axis.gh (Grasshopper 0.9.76)

number_slider = Slider(949, range=0..1000)
number_slider_2 = Slider(1550, range=0..10000)
pt = Point(<point referenced from the Rhino model>)
rectangle = Rectangle(Plane=pt, XSize=number_slider, YSize=number_slider_2, Radius=0)  # -> Rectangle, Length
explode = Explode(Curve=rectangle.Rectangle, Recursive=True)  # -> Segments, Vertices
rad = Radians(Degrees=Slider(-90, range=-90..100))
Z = UnitZ(Factor=1)
item = ListItem(List=explode.Segments, Index=0, Wrap=True)  # -> Item, Item1, Item2, Item3
rad_2 = Radians(Degrees=Slider(42, range=-90..90))
Y = UnitY(Factor=1)
crv = Curve(item.Item3)
Z_2 = UnitZ(Factor=Slider(200, range=0..1000))
eval = EvaluateCurve(Curve=reparameterize(crv), Parameter=Slider(0.8, range=0..1))  # -> Point, Tangent, Angle
pt_2 = Point(eval.Point)
move = Move(Geometry=pt_2, Motion=Z_2)  # -> Geometry, Transform
ln = Line(StartPoint=move.Geometry, EndPoint=pt_2)
circle = CircleCNR(Center=pt_2, Normal=Vector(0, 0, 1), Radius=Slider(200, range=0..1000))
line = LineSDL(Start=move.Geometry, Direction=Z, Length=Slider(443, range=0..1000))
rot3d = Rotate3D(Geometry=rectangle.Rectangle, Angle=rad, Center=pt_2, Axis=Y)  # -> Geometry, Transform
rad_3 = Radians(Degrees=Slider(177, range=-180..180))
X = UnitX(Factor=number_slider)
rectangle_2 = Rectangle(Plane=pt, XSize=Slider(100, range=0..100), YSize=number_slider_2, Radius=Slider(100, range=0..100))  # -> Rectangle, Length
move_2 = Move(Geometry=rot3d.Geometry, Motion=X)  # -> Geometry, Transform
rad_4 = Radians(Degrees=Slider(90, range=0..100))
rotate = Rotate(Geometry=circle, Angle=rad_3, Plane=circle)  # -> Geometry, Transform
X_2 = UnitX(Factor=Slider(300, range=0..1000))
extr = Extrude(Base=move_2.Geometry, Direction=X_2)
eval_2 = EvaluateCurve(Curve=reparameterize(rotate.Geometry), Parameter=Slider(0.5, range=0..1))  # -> Point, Tangent, Angle
ln_2 = Line(StartPoint=rotate.Geometry, EndPoint=eval_2.Point)
rot3d_2 = Rotate3D(Geometry=line, Angle=rad_2, Center=move.Geometry, Axis=ln_2)  # -> Geometry, Transform
rot3d_3 = Rotate3D(Geometry=rectangle_2.Rectangle, Angle=rad_4, Center=pt, Axis=crv)  # -> Geometry, Transform
end = EndPoints(Curve=rot3d_2.Geometry)  # -> Start, End
Y_2 = UnitY(Factor=number_slider)
X_3 = UnitX(Factor=number_slider)
extr_2 = Extrude(Base=rot3d_3.Geometry, Direction=X_3)
rad_5 = Radians(Degrees=Slider(59, range=0..180))
rot3d_4 = Rotate3D(Geometry=rot3d_2.Geometry, Angle=rad_5, Center=end.End, Axis=ln_2)  # -> Geometry, Transform
Z_3 = UnitZ(Factor=1)
end_2 = EndPoints(Curve=rot3d_4.Geometry)  # -> Start, End
line_2 = LineSDL(Start=end_2.Start, Direction=Z_3, Length=Slider(148, range=0..1000))
rad_6 = Radians(Degrees=Slider(-89, range=-180..180))
rot3d_5 = Rotate3D(Geometry=line_2, Angle=rad_6, Center=end_2.Start, Axis=rot3d_4.Geometry)  # -> Geometry, Transform
