# Grasshopper definition XYMOVEMENT.gh (Grasshopper 0.9.76)

md_slider = MDSlider(
    slider_value=Point(0.7689758859, 0.3069266808, 0.5),
    SliderMode=0,
    x_domain=Domain(0, 1),
    y_domain=Domain(0, 1),
    z_domain=Domain(0, 1))
pt = Point(md_slider)
pt_2 = ConstructPoint(XCoordinate=0, YCoordinate=0, ZCoordinate=0)
pdecon = Deconstruct(Point=pt)  # -> XComponent, YComponent, ZComponent
panel = Panel(pdecon.XComponent)
panel_2 = Panel(pdecon.YComponent)
number_slider = Slider(38.4, range=0..90)
Y = UnitY(Factor=number_slider)
Y_2 = UnitY(Factor=1)
number_slider_2 = Slider(0.1, range=0..1)
X = UnitX(Factor=number_slider)
X_2 = UnitX(Factor=number_slider)
line = LineSDL(Start=pt_2, Direction=X, Length=number_slider)
line_2 = LineSDL(Start=pt_2, Direction=Y_2, Length=number_slider)
Y_3 = UnitY(Factor=1)
move = Move(Geometry=line_2, Motion=X_2)  # -> Geometry, Transform
move_2 = Move(Geometry=line, Motion=Y)  # -> Geometry, Transform
eval = EvaluateCurve(Curve=[line_2, move.Geometry], Parameter=panel)  # -> Point, Tangent, Angle
pline = PolyLine(Vertices=eval.Point, Closed=False)
eval_2 = EvaluateCurve(Curve=[line, move_2.Geometry], Parameter=panel_2)  # -> Point, Tangent, Angle
pipe = Pipe(Curve=pline, Radius=number_slider_2, Caps=0)
pline_2 = PolyLine(Vertices=flatten(eval_2.Point), Closed=False)
number_slider_3 = Slider(0.5, range=0..1)
Y_4 = UnitY(Factor=Slider(0.5, range=0..1))
ccx = CurveCurve(CurveA=pline, CurveB=pline_2)  # -> Points, ParamsA, ParamsB
multiplication = Multiplication(A=Y_4, B="-1")
pipe_2 = Pipe(Curve=pline_2, Radius=number_slider_2, Caps=0)
pipe_3 = Pipe(Curve=pline_2, Radius=number_slider_2, Caps=0)
box = CenterBox(Base=ccx.Points, X=1, Y=1, Z=1)
Y_5 = UnitY(Factor=number_slider_3)
move_3 = Move(Geometry=pipe, Motion=Y_4)  # -> Geometry, Transform
move_4 = Move(Geometry=pipe, Motion=multiplication)  # -> Geometry, Transform
X_3 = UnitX(Factor=number_slider_3)
multiplication_2 = Multiplication(A=X_3, B="-1")
move_5 = Move(Geometry=pipe_3, Motion=X_3)  # -> Geometry, Transform
move_6 = Move(Geometry=pipe_3, Motion=multiplication_2)  # -> Geometry, Transform
